% Simulink data dictionary fms_public.sldd

AvFmsVerticalMode = enum(DefaultValue="ThrottleEAS")
  ThrottleEAS = 0
  ClimbRateEAS = 1

AvFmsLateralMode = enum(DefaultValue="Bank")
  Bank = 0
  Course = 1

AvFmsFlightModes = Simulink.Bus()
  vertical_mode: Enum: AvFmsVerticalMode
  lateral_mode: Enum: AvFmsLateralMode